test file "ForwardVehicleSensorFusionPILTests"

suite "PIL Equivalence Tests"

  case "scenario_LFACC_01_Curve_DecelTarget" [equivalence]
    simulation 1:
      model ForwardVehicleSensorFusionTestBench
      post-load callback:
        % Select a test scenario and run the setup script.
        scenarioName = "scenario_LFACC_01_Curve_DecelTarget";
        helperSLForwardVehicleSensorFusionSetup("scenarioFcnName",scenarioName);

        % Set normal simulation mode for the Forward Vehicle Sensor Fusion reference model.
        set_param("ForwardVehicleSensorFusionTestBench/Forward Vehicle Sensor Fusion", "SimulationMode", "Normal");
    simulation 2:
      model ForwardVehicleSensorFusionTestBench
      post-load callback:
        % Set hardware board for PIL simulation.
        set_param("ForwardVehicleSensorFusion", "HardwareBoard", "NVIDIA Jetson");

        % Set PIL simulation mode for the Forward Vehicle Sensor Fusion reference model.
        set_param("ForwardVehicleSensorFusionTestBench/Forward Vehicle Sensor Fusion", "SimulationMode", "Processor-in-the-loop");

        % Set model parameters for PIL simulation.
        helperSetModelParametersForPIL("ForwardVehicleSensorFusion");
    equivalence criteria (4 of 4008 signals compared)
      gospa: abs tol 0.01
      localization_error: abs tol 0.01
      miss_target_error: abs tol 0.01
      false_tracks_error: abs tol 0.01

  case "scenario_LFACC_02_Curve_AutoRetarget" [equivalence]
    simulation 1:
      model ForwardVehicleSensorFusionTestBench
      post-load callback:
        % Select a test scenario and run the setup script.
        scenarioName = "scenario_LFACC_02_Curve_AutoRetarget";
        helperSLForwardVehicleSensorFusionSetup("scenarioFcnName",scenarioName);

        % Set normal simulation mode for the Forward Vehicle Sensor Fusion reference model.
        set_param("ForwardVehicleSensorFusionTestBench/Forward Vehicle Sensor Fusion", "SimulationMode", "Normal");
    simulation 2:
      model ForwardVehicleSensorFusionTestBench
      post-load callback: same code as in post-load callback of case "scenario_LFACC_01_Curve_DecelTarget"
    equivalence criteria (4 of 4268 signals compared)
      gospa: abs tol 0.01
      localization_error: abs tol 0.01
      miss_target_error: abs tol 0.01
      false_tracks_error: abs tol 0.01

  case "scenario_LFACC_03_Curve_StopnGo" [equivalence]
    simulation 1:
      model ForwardVehicleSensorFusionTestBench
      post-load callback:
        % Select a test scenario and run the setup script.
        scenarioName = "scenario_LFACC_03_Curve_StopnGo";
        helperSLForwardVehicleSensorFusionSetup("scenarioFcnName",scenarioName);

        % Set normal simulation mode for the Forward Vehicle Sensor Fusion reference model.
        set_param("ForwardVehicleSensorFusionTestBench/Forward Vehicle Sensor Fusion", "SimulationMode", "Normal");
    simulation 2:
      model ForwardVehicleSensorFusionTestBench
      post-load callback:
        % Select hardware board for PIL simulation.
        set_param("ForwardVehicleSensorFusion", "HardwareBoard", "NVIDIA Jetson");

        % Set PIL simulation mode for the Forward Vehicle Sensor Fusion reference model.
        set_param("ForwardVehicleSensorFusionTestBench/Forward Vehicle Sensor Fusion", "SimulationMode", "Processor-in-the-loop");

        % Set model parameters for PIL simulation.
        helperSetModelParametersForPIL("ForwardVehicleSensorFusion");
    equivalence criteria (4 of 4268 signals compared)
      gospa: abs tol 0.01
      localization_error: abs tol 0.01
      miss_target_error: abs tol 0.01
      false_tracks_error: abs tol 0.01

  case "scenario_LFACC_04_Curve_CutInOut" [equivalence]
    simulation 1:
      model ForwardVehicleSensorFusionTestBench
      post-load callback:
        % Select a test scenario and run the setup script.
        scenarioName = "scenario_LFACC_04_Curve_CutInOut";
        helperSLForwardVehicleSensorFusionSetup("scenarioFcnName",scenarioName);

        % Set normal simulation mode for the Forward Vehicle Sensor Fusion reference model.
        set_param("ForwardVehicleSensorFusionTestBench/Forward Vehicle Sensor Fusion", "SimulationMode", "Normal");
    simulation 2:
      model ForwardVehicleSensorFusionTestBench
      post-load callback: same code as in post-load callback of case "scenario_LFACC_01_Curve_DecelTarget"
    equivalence criteria (4 of 4268 signals compared)
      gospa: abs tol 0.01
      localization_error: abs tol 0.01
      miss_target_error: abs tol 0.01
      false_tracks_error: abs tol 0.01

  case "scenario_LFACC_05_Curve_CutInOut_TooClose" [equivalence]
    simulation 1:
      model ForwardVehicleSensorFusionTestBench
      post-load callback:
        % Select a test scenario and run the setup script.
        scenarioName = "scenario_LFACC_05_Curve_CutInOut_TooClose";
        helperSLForwardVehicleSensorFusionSetup("scenarioFcnName",scenarioName);

        % Set normal simulation mode for the Forward Vehicle Sensor Fusion reference model.
        set_param("ForwardVehicleSensorFusionTestBench/Forward Vehicle Sensor Fusion", "SimulationMode", "Normal");
    simulation 2:
      model ForwardVehicleSensorFusionTestBench
      post-load callback: same code as in post-load callback of case "scenario_LFACC_01_Curve_DecelTarget"
    equivalence criteria (4 of 4268 signals compared)
      gospa: abs tol 0.01
      localization_error: abs tol 0.01
      miss_target_error: abs tol 0.01
      false_tracks_error: abs tol 0.01

  case "scenario_LFACC_06_Straight_StopandGoLeadCar" [equivalence]
    simulation 1:
      model ForwardVehicleSensorFusionTestBench
      post-load callback:
        % Select a test scenario and run the setup script.
        scenarioName = "scenario_LFACC_06_Straight_StopandGoLeadCar";
        helperSLForwardVehicleSensorFusionSetup("scenarioFcnName",scenarioName);

        % Set normal simulation mode for the Forward Vehicle Sensor Fusion reference model.
        set_param("ForwardVehicleSensorFusionTestBench/Forward Vehicle Sensor Fusion", "SimulationMode", "Normal");
    simulation 2:
      model ForwardVehicleSensorFusionTestBench
      post-load callback: same code as in post-load callback of case "scenario_LFACC_01_Curve_DecelTarget"
    equivalence criteria (4 of 4268 signals compared)
      gospa: abs tol 0.01
      localization_error: abs tol 0.01
      miss_target_error: abs tol 0.01
      false_tracks_error: abs tol 0.01

  case "scenario_FVSF_01_Curve_FourVehicles" [equivalence]
    simulation 1:
      model ForwardVehicleSensorFusionTestBench
      post-load callback:
        % Select a test scenario and run the setup script.
        scenarioName = "scenario_FVSF_01_Curve_FourVehicles";
        helperSLForwardVehicleSensorFusionSetup("scenarioFcnName",scenarioName);

        % Set normal simulation mode the Forward Vehicle Sensor Fusion reference model.
        set_param("ForwardVehicleSensorFusionTestBench/Forward Vehicle Sensor Fusion", "SimulationMode", "Normal");
    simulation 2:
      model ForwardVehicleSensorFusionTestBench
      post-load callback: same code as in post-load callback of case "scenario_LFACC_01_Curve_DecelTarget"
    equivalence criteria (4 of 4268 signals compared)
      gospa: abs tol 0.01
      localization_error: abs tol 0.01
      miss_target_error: abs tol 0.01
      false_tracks_error: abs tol 0.01

  case "scenario_FVSF_02_Straight_FourVehicles" [equivalence]
    simulation 1:
      model ForwardVehicleSensorFusionTestBench
      post-load callback:
        % Select a test scenario and run the setup script.
        scenarioName = "scenario_FVSF_02_Straight_FourVehicles";
        helperSLForwardVehicleSensorFusionSetup("scenarioFcnName",scenarioName);

        % Set normal simulation mode for the Forward Vehicle Sensor Fusion reference model.
        set_param("ForwardVehicleSensorFusionTestBench/Forward Vehicle Sensor Fusion", "SimulationMode", "Normal");
    simulation 2:
      model ForwardVehicleSensorFusionTestBench
      post-load callback: same code as in post-load callback of case "scenario_LFACC_01_Curve_DecelTarget"
    equivalence criteria (4 of 4268 signals compared)
      gospa: abs tol 0.01
      localization_error: abs tol 0.01
      miss_target_error: abs tol 0.01
      false_tracks_error: abs tol 0.01

  case "scenario_FVSF_03_Curve_SixVehicles" [equivalence]
    simulation 1:
      model ForwardVehicleSensorFusionTestBench
      post-load callback:
        % Select a test scenario and run the setup script.
        scenarioName = "scenario_FVSF_03_Curve_SixVehicles";
        helperSLForwardVehicleSensorFusionSetup("scenarioFcnName",scenarioName);

        % Set normal simulation mode for the Forward Vehicle Sensor Fusion reference model.
        set_param("ForwardVehicleSensorFusionTestBench/Forward Vehicle Sensor Fusion", "SimulationMode", "Normal");
    simulation 2:
      model ForwardVehicleSensorFusionTestBench
      post-load callback: same code as in post-load callback of case "scenario_LFACC_01_Curve_DecelTarget"
    equivalence criteria (4 of 4268 signals compared)
      gospa: abs tol 0.01
      localization_error: abs tol 0.01
      miss_target_error: abs tol 0.01
      false_tracks_error: abs tol 0.01

  case "scenario_FVSF_04_Straight_ThreeVehicles" [equivalence]
    simulation 1:
      model ForwardVehicleSensorFusionTestBench
      post-load callback:
        % Select a test scenario and run the setup script.
        scenarioName = "scenario_FVSF_04_Straight_ThreeVehicles";
        helperSLForwardVehicleSensorFusionSetup("scenarioFcnName",scenarioName);

        % Set normal simulation mode for the Forward Vehicle Sensor Fusion reference model.
        set_param("ForwardVehicleSensorFusionTestBench/Forward Vehicle Sensor Fusion", "SimulationMode", "Normal");
    simulation 2:
      model ForwardVehicleSensorFusionTestBench
      post-load callback: same code as in post-load callback of case "scenario_LFACC_01_Curve_DecelTarget"
    equivalence criteria (4 of 4268 signals compared)
      gospa: abs tol 0.01
      localization_error: abs tol 0.01
      miss_target_error: abs tol 0.01
      false_tracks_error: abs tol 0.01

  case "scenario_FVSF_05_Straight_TwoVehicles" [equivalence]
    simulation 1:
      model ForwardVehicleSensorFusionTestBench
      post-load callback:
        % Select a test scenario and run the setup script.
        scenarioName = "scenario_FVSF_05_Straight_TwoVehicles";
        helperSLForwardVehicleSensorFusionSetup("scenarioFcnName",scenarioName);

        % Set normal simulation mode for the Forward Vehicle Sensor Fusion reference model.
        set_param("ForwardVehicleSensorFusionTestBench/Forward Vehicle Sensor Fusion", "SimulationMode", "Normal");
    simulation 2:
      model ForwardVehicleSensorFusionTestBench
      post-load callback: same code as in post-load callback of case "scenario_LFACC_01_Curve_DecelTarget"
    equivalence criteria (4 of 4268 signals compared)
      gospa: abs tol 0.01
      localization_error: abs tol 0.01
      miss_target_error: abs tol 0.01
      false_tracks_error: abs tol 0.01