test file "VisionVehicleDetectorTestAssessments"
  coverage: Decision, MCDC, Condition

suite "Test Scenarios"

  case "scenario_VVD_01_Curve_FiveVehicles" [simulation]
    model VisionVehicleDetectorTestBench
    pre-load callback:
      detectorVariantName = evalin('base','detectorVariantName');
    post-load callback:
      scenarioName = "scenario_VVD_01_Curve_FiveVehicles";
      helperSLVisionVehicleDetectorSetup("scenarioFcnName",scenarioName, "detectorVariantName", detectorVariantName);
    cleanup callback:
      helperPlotDetectionMetrics(detectorVariantName,sltest_simout.logsout);
    custom criteria:
      % Thresholds for precision and missrate
      precisionThreshold = 0.8;
      missrateThreshold = 0.2;
      % Verify precision and missrate
      helperVerifyPrecisionAndMissrate(test,precisionThreshold,missrateThreshold);
    assessment "Assessment1": At any point of time, TruePositives <= NumActorsTruth must be true
    assessment "Assessment2": At any point of time, FalsePositives <= 1 must be true
    assessment "Assessment3": At any point of time, TruePositives + FalseNegatives == NumActorsTruth must be true
      TruePositives: signal VisionVehicleDetectorTestBench/Metrics Assessment/Evaluate Frame, port 2
      NumActorsTruth: signal VisionVehicleDetectorTestBench/Metrics Assessment/Evaluate Frame, port 1
      FalseNegatives: signal VisionVehicleDetectorTestBench/Metrics Assessment/Evaluate Frame, port 4
      FalsePositives: signal VisionVehicleDetectorTestBench/Metrics Assessment/Evaluate Frame, port 3

  case "scenario_LFACC_01_Curve_DecelTarget" [simulation]
    model VisionVehicleDetectorTestBench
    pre-load callback:
      detectorVariantName = evalin('base','detectorVariantName');
    post-load callback:
      scenarioName = "scenario_LFACC_01_Curve_DecelTarget";
      helperSLVisionVehicleDetectorSetup("scenarioFcnName",scenarioName, "detectorVariantName", detectorVariantName);
    cleanup callback:
      helperPlotDetectionMetrics(detectorVariantName,sltest_simout.logsout);
    custom criteria: same code as in custom criteria of case "scenario_VVD_01_Curve_FiveVehicles"
    assessment "Assessment1": At any point of time, TruePositives <= NumActorsTruth must be true
    assessment "Assessment2": At any point of time, FalsePositives <= 1 must be true
    assessment "Assessment3": At any point of time, TruePositives + FalseNegatives == NumActorsTruth must be true
      NumActorsTruth: signal VisionVehicleDetectorTestBench/Metrics Assessment/Evaluate Frame, port 1
      TruePositives: signal VisionVehicleDetectorTestBench/Metrics Assessment/Evaluate Frame, port 2
      FalsePositives: signal VisionVehicleDetectorTestBench/Metrics Assessment/Evaluate Frame, port 3
      FalseNegatives: signal VisionVehicleDetectorTestBench/Metrics Assessment/Evaluate Frame, port 4

  case "scenario_LFACC_02_Curve_AutoRetarget" [simulation]
    model VisionVehicleDetectorTestBench
    pre-load callback:
      detectorVariantName = evalin('base','detectorVariantName');
    post-load callback:
      scenarioName = "scenario_LFACC_02_Curve_AutoRetarget";
      helperSLVisionVehicleDetectorSetup("scenarioFcnName",scenarioName, "detectorVariantName", detectorVariantName);
    cleanup callback:
      helperPlotDetectionMetrics(detectorVariantName,sltest_simout.logsout);
    custom criteria: same code as in custom criteria of case "scenario_VVD_01_Curve_FiveVehicles"
    assessment "Assessment1": At any point of time, TruePositives <= NumActorsTruth must be true
    assessment "Assessment2": At any point of time, FalsePositives <= 1 must be true
    assessment "Assessment3": At any point of time, TruePositives + FalseNegatives == NumActorsTruth must be true
      NumActorsTruth: signal VisionVehicleDetectorTestBench/Metrics Assessment/Evaluate Frame, port 1
      TruePositives: signal VisionVehicleDetectorTestBench/Metrics Assessment/Evaluate Frame, port 2
      FalsePositives: signal VisionVehicleDetectorTestBench/Metrics Assessment/Evaluate Frame, port 3
      FalseNegatives: signal VisionVehicleDetectorTestBench/Metrics Assessment/Evaluate Frame, port 4

  case "scenario_LFACC_03_Curve_StopnGo" [simulation]
    model VisionVehicleDetectorTestBench
    pre-load callback:
      detectorVariantName = evalin('base','detectorVariantName');
    post-load callback:
      scenarioName = "scenario_LFACC_03_Curve_StopnGo";
      helperSLVisionVehicleDetectorSetup("scenarioFcnName",scenarioName, "detectorVariantName", detectorVariantName);
    cleanup callback:
      helperPlotDetectionMetrics(detectorVariantName,sltest_simout.logsout);
    custom criteria: same code as in custom criteria of case "scenario_VVD_01_Curve_FiveVehicles"
    assessment "Assessment1": At any point of time, TruePositives <= NumActorsTruth must be true
    assessment "Assessment2": At any point of time, FalsePositives <= 1 must be true
    assessment "Assessment3": At any point of time, TruePositives + FalseNegatives == NumActorsTruth must be true
      FalseNegatives: signal VisionVehicleDetectorTestBench/Metrics Assessment/Evaluate Frame, port 4
      FalsePositives: signal VisionVehicleDetectorTestBench/Metrics Assessment/Evaluate Frame, port 3
      TruePositives: signal VisionVehicleDetectorTestBench/Metrics Assessment/Evaluate Frame, port 2
      NumActorsTruth: signal VisionVehicleDetectorTestBench/Metrics Assessment/Evaluate Frame, port 1

  case "scenario_LFACC_04_Curve_CutInOut" [simulation]
    model VisionVehicleDetectorTestBench
    pre-load callback:
      detectorVariantName = evalin('base','detectorVariantName');
    post-load callback:
      scenarioName = "scenario_LFACC_04_Curve_CutInOut";
      helperSLVisionVehicleDetectorSetup("scenarioFcnName",scenarioName, "detectorVariantName", detectorVariantName);
    cleanup callback:
      helperPlotDetectionMetrics(detectorVariantName,sltest_simout.logsout);
    custom criteria: same code as in custom criteria of case "scenario_VVD_01_Curve_FiveVehicles"
    assessment "Assessment1": At any point of time, TruePositives <= NumActorsTruth must be true
    assessment "Assessment2": At any point of time, FalsePositives <= 1 must be true
    assessment "Assessment3": At any point of time, TruePositives + FalseNegatives == NumActorsTruth must be true
      TruePositives: signal VisionVehicleDetectorTestBench/Metrics Assessment/Evaluate Frame, port 2
      NumActorsTruth: signal VisionVehicleDetectorTestBench/Metrics Assessment/Evaluate Frame, port 1
      FalsePositives: signal VisionVehicleDetectorTestBench/Metrics Assessment/Evaluate Frame, port 3
      FalseNegatives: signal VisionVehicleDetectorTestBench/Metrics Assessment/Evaluate Frame, port 4

  case "scenario_LFACC_05_Curve_CutInOut_TooClose" [simulation]
    model VisionVehicleDetectorTestBench
    pre-load callback:
      detectorVariantName = evalin('base','detectorVariantName');
    post-load callback:
      scenarioName = "scenario_LFACC_05_Curve_CutInOut_TooClose";
      helperSLVisionVehicleDetectorSetup("scenarioFcnName",scenarioName, "detectorVariantName", detectorVariantName);
    cleanup callback:
      helperPlotDetectionMetrics(detectorVariantName,sltest_simout.logsout);
    custom criteria: same code as in custom criteria of case "scenario_VVD_01_Curve_FiveVehicles"
    assessment "Assessment1": At any point of time, TruePositives <= NumActorsTruth must be true
    assessment "Assessment2": At any point of time, FalsePositives <= 1 must be true
    assessment "Assessment3": At any point of time, TruePositives + FalseNegatives == NumActorsTruth must be true
      TruePositives: signal VisionVehicleDetectorTestBench/Metrics Assessment/Evaluate Frame, port 2
      NumActorsTruth: signal VisionVehicleDetectorTestBench/Metrics Assessment/Evaluate Frame, port 1
      FalsePositives: signal VisionVehicleDetectorTestBench/Metrics Assessment/Evaluate Frame, port 3
      FalseNegatives: signal VisionVehicleDetectorTestBench/Metrics Assessment/Evaluate Frame, port 4

  case "scenario_LFACC_06_Straight_StopandGoLeadCar" [simulation]
    model VisionVehicleDetectorTestBench
    pre-load callback:
      detectorVariantName = evalin('base','detectorVariantName');
    post-load callback:
      scenarioName = "scenario_LFACC_06_Straight_StopandGoLeadCar";
      helperSLVisionVehicleDetectorSetup("scenarioFcnName",scenarioName, "detectorVariantName", detectorVariantName);
    cleanup callback:
      helperPlotDetectionMetrics(detectorVariantName,sltest_simout.logsout);
    custom criteria:
      % Thresholds for precision and missrate
      precisionThreshold = 0.6;
      missrateThreshold = 0.4;
      % Verify precision and missrate
      helperVerifyPrecisionAndMissrate(test,precisionThreshold,missrateThreshold);
    assessment "Assessment1": At any point of time, TruePositives <= NumActorsTruth must be true
    assessment "Assessment2": At any point of time, FalsePositives <= 1 must be true
    assessment "Assessment3": At any point of time, TruePositives + FalseNegatives == NumActorsTruth must be true
      TruePositives: signal VisionVehicleDetectorTestBench/Metrics Assessment/Evaluate Frame, port 2
      NumActorsTruth: signal VisionVehicleDetectorTestBench/Metrics Assessment/Evaluate Frame, port 1
      FalsePositives: signal VisionVehicleDetectorTestBench/Metrics Assessment/Evaluate Frame, port 3
      FalseNegatives: signal VisionVehicleDetectorTestBench/Metrics Assessment/Evaluate Frame, port 4

  case "scenario_FVSF_01_Curve_FourVehicles" [simulation]
    model VisionVehicleDetectorTestBench
    pre-load callback:
      detectorVariantName = evalin('base','detectorVariantName');
    post-load callback:
      scenarioName = "scenario_FVSF_01_Curve_FourVehicles";
      helperSLVisionVehicleDetectorSetup("scenarioFcnName",scenarioName, "detectorVariantName", detectorVariantName);
    cleanup callback:
      helperPlotDetectionMetrics(detectorVariantName,sltest_simout.logsout);
    custom criteria:
      % Thresholds for precision and missrate
      precisionThreshold = 0.4;
      missrateThreshold = 0.7;
      % Verify precision and missrate
      helperVerifyPrecisionAndMissrate(test,precisionThreshold,missrateThreshold);
    assessment "Assessment1": At any point of time, TruePositives <= NumActorsTruth must be true
    assessment "Assessment2": At any point of time, FalsePositives <= 1 must be true
    assessment "Assessment3": At any point of time, TruePositives + FalseNegatives == NumActorsTruth must be true
      TruePositives: signal VisionVehicleDetectorTestBench/Metrics Assessment/Evaluate Frame, port 2
      NumActorsTruth: signal VisionVehicleDetectorTestBench/Metrics Assessment/Evaluate Frame, port 1
      FalsePositives: signal VisionVehicleDetectorTestBench/Metrics Assessment/Evaluate Frame, port 3
      FalseNegatives: signal VisionVehicleDetectorTestBench/Metrics Assessment/Evaluate Frame, port 4

  case "scenario_FVSF_02_Straight_FourVehicles" [simulation]
    model VisionVehicleDetectorTestBench
    pre-load callback:
      detectorVariantName = evalin('base','detectorVariantName');
    post-load callback:
      scenarioName = "scenario_FVSF_02_Straight_FourVehicles";
      helperSLVisionVehicleDetectorSetup("scenarioFcnName",scenarioName, "detectorVariantName", detectorVariantName);
    cleanup callback:
      helperPlotDetectionMetrics(detectorVariantName,sltest_simout.logsout);
    custom criteria:
      % Thresholds for precision and missrate
      precisionThreshold = 0.75;
      missrateThreshold = 0.25;
      % Verify precision and missrate
      helperVerifyPrecisionAndMissrate(test,precisionThreshold,missrateThreshold);
    assessment "Assessment1": At any point of time, TruePositives <= NumActorsTruth must be true
    assessment "Assessment2": At any point of time, FalsePositives <= 1 must be true
    assessment "Assessment3": At any point of time, TruePositives + FalseNegatives == NumActorsTruth must be true
      TruePositives: signal VisionVehicleDetectorTestBench/Metrics Assessment/Evaluate Frame, port 2
      NumActorsTruth: signal VisionVehicleDetectorTestBench/Metrics Assessment/Evaluate Frame, port 1
      FalsePositives: signal VisionVehicleDetectorTestBench/Metrics Assessment/Evaluate Frame, port 3
      FalseNegatives: signal VisionVehicleDetectorTestBench/Metrics Assessment/Evaluate Frame, port 4

  case "scenario_FVSF_03_Curve_SixVehicles" [simulation]
    model VisionVehicleDetectorTestBench
    pre-load callback:
      detectorVariantName = evalin('base','detectorVariantName');
    post-load callback:
      scenarioName = "scenario_FVSF_03_Curve_SixVehicles";
      helperSLVisionVehicleDetectorSetup("scenarioFcnName",scenarioName, "detectorVariantName", detectorVariantName);
    cleanup callback:
      helperPlotDetectionMetrics(detectorVariantName,sltest_simout.logsout);
    custom criteria:
      % Thresholds for precision and missrate
      precisionThreshold = 0.75;
      missrateThreshold = 0.3;
      % Verify precision and missrate
      helperVerifyPrecisionAndMissrate(test,precisionThreshold,missrateThreshold);
    assessment "Assessment1": At any point of time, TruePositives <= NumActorsTruth must be true
    assessment "Assessment2": At any point of time, FalsePositives <= NumActorsTruth must be true
    assessment "Assessment3": At any point of time, TruePositives + FalseNegatives == NumActorsTruth must be true
      TruePositives: signal VisionVehicleDetectorTestBench/Metrics Assessment/Evaluate Frame, port 2
      NumActorsTruth: signal VisionVehicleDetectorTestBench/Metrics Assessment/Evaluate Frame, port 1
      FalsePositives: signal VisionVehicleDetectorTestBench/Metrics Assessment/Evaluate Frame, port 3
      FalseNegatives: signal VisionVehicleDetectorTestBench/Metrics Assessment/Evaluate Frame, port 4